# Grasshopper definition  Urbanism_Barcelona .gh (Grasshopper 1.0.7)
# plug-ins: Human

pt_attractor = Point([<point referenced from the Rhino model> x2])
srf_topo = Surface(<surface referenced from the Rhino model>)
crv_streets = Curve([<curve referenced from the Rhino model> x51])
crv_500x500 = Curve(<curve referenced from the Rhino model>)
crv_church = Curve(<curve referenced from the Rhino model>)

crv_streets_2 = Curve(crv_streets)
objatts = ObjectAttributes(ObjectOrAttributes=crv_streets_2)  # -> Name, LayerName, LayerFullPath, Color, MaterialName, LinetypeName, GroupIndices, PlotWeight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
item = ListItem(List=objatts.UserDataValues, Index=0, Wrap=True)  # -> flatten(Item)
cset = CreateSet(List=item)  # -> graft(Set), Map
equals = Equality(FirstNumber=cset.Set, SecondNumber=item)  # -> Equality, Inequality
cull = CullPattern(List=crv_streets_2, CullPattern=equals.Equality)
join = JoinCurves(Curves=cull, Preserve=False)
lng = ListLength(List=join)
dup = DuplicateData(Data=cset.Set, Number=lng, Order=True)

crv_500x500_2 = Curve(crv_500x500)
crv_church_2 = Curve(crv_church)

boundary = BoundarySurfaces(Edges=crv_500x500_2)
area = Area(Geometry=crv_church_2)  # -> Area, Centroid
srfsplit = SurfaceSplit(Surface=boundary, Curves=crv_church_2)  # -> graft(Fragments)
srf_cp = SurfaceClosestPoint(Point=area.Centroid, Surface=srfsplit)  # -> Point, UVPoint, Distance
sort = SortList(Keys=srf_cp.Distance)  # -> Keys, ValuesA
item_2 = ListItem(List=sort.Keys, Index=0, Wrap=True)
smaller = SmallerThan(FirstNumber=item_2, SecondNumber="0.1")  # -> SmallerThan, OrEqualTo
dispatch = Dispatch(List=srfsplit, DispatchPattern=smaller.SmallerThan)  # -> ListA, ListB

srf_city_blocks = Surface(dispatch.ListB)
srf_church = Surface(dispatch.ListA)

num_streetwidths = Number(flatten(dup))
crv_streets_3 = Curve(flatten(join))

srf_ground = Surface(flatten(srf_city_blocks))
crv_streets_4 = Curve(flatten(crv_streets_3))
num_streetwidths_2 = Number(flatten(num_streetwidths))

offset = OffsetCurve(Curve=graft(crv_streets_4), Distance=expr("x/2", graft(num_streetwidths_2)), Plane=PlaneXY(0, 0, 0), Corners=1)
offset_2 = OffsetCurve(Curve=graft(crv_streets_4), Distance=expr("-x/2", graft(num_streetwidths_2)), Plane=PlaneXY(0, 0, 0), Corners=1)
srfsplit_2 = SurfaceSplit(Surface=srf_ground, Curves=crv_streets_4)
graft = GraftTree(Tree=srfsplit_2, IncludeEmptyLists=True, IncludeNullItems=True)
edges = BrepEdges(Brep=graft)  # -> Naked, Interior, NonManifold
join_2 = JoinCurves(Curves=edges.Naked, Preserve=False)
join_3 = JoinCurves(Curves=offset, Preserve=False)
end = EndPoints(Curve=offset)  # -> Start, End
end_2 = EndPoints(Curve=offset_2)  # -> Start, End
area_2 = Area(Geometry=join_2)  # -> Area, Centroid
flatten = FlattenTree(Tree=join_3, Path="{0}")
srfsplit_3 = SurfaceSplit(Surface=graft, Curves=flatten)
ln = Line(StartPoint=end_2.End, EndPoint=end.End)
ln_2 = Line(StartPoint=end_2.Start, EndPoint=end.Start)
flatten_2 = FlattenTree(Tree=area_2.Centroid, Path="{0}")
graft_2 = GraftTree(Tree=srfsplit_3, IncludeEmptyLists=True, IncludeNullItems=True)  # -> simplify(Tree)
srf_cp_2 = SurfaceClosestPoint(Point=flatten_2, Surface=graft_2)  # -> Point, UVPoint, Distance
sort_2 = SortList(Keys=srf_cp_2.Distance)  # -> Keys, ValuesA
item_3 = ListItem(List=sort_2.Keys, Index=0, Wrap=True)
smaller_2 = SmallerThan(FirstNumber=item_3, SecondNumber="0.1")  # -> SmallerThan, OrEqualTo
cull_2 = CullPattern(List=graft_2, CullPattern=smaller_2.SmallerThan)
edges_2 = BrepEdges(Brep=flatten(cull_2))  # -> Naked, Interior, NonManifold
join_4 = JoinCurves(Curves=edges_2.Naked, Preserve=False)
crv_cityblocks = Curve(join_4)

panel = Panel("4")  # disabled
panel_2 = Panel("15")  # disabled

crv_cityblocks_2 = Curve(simplify(graft(crv_cityblocks)))  # disabled
pt_attractor_2 = Point(pt_attractor)  # disabled
num_max_width = Number(panel_2)  # disabled
num_min_width = Number(panel)  # disabled

area_3 = Area(Geometry=crv_cityblocks_2)  # -> Area, Centroid; disabled
dist = Distance(PointA=area_3.Centroid, PointB=pt_attractor_2)  # disabled
sort_3 = SortList(Keys=dist)  # -> Keys, ValuesA; disabled
panel_3 = Panel("0")  # disabled
item_4 = ListItem(List=sort_3.Keys, Index=panel_3, Wrap=True)  # disabled
bnd = Bounds(Numbers=flatten(item_4))  # disabled
dom = ConstructDomain(DomainStart=num_max_width, DomainEnd=num_min_width)  # disabled
remap = RemapNumbers(Value=item_4, Source=bnd, Target=Domain(0, 1))  # -> Mapped, Clipped; disabled
graph = GraphMapper(
    remap.Mapped,
    x0=0,
    x1=1,
    y0=0,
    y1=1,
    container_name="Bezier",
    cpx=[0, 0.544336617, 0, 1],
    cpy=[0.2120679617, 0.256644845, 1, 0.6968374848])  # disabled
remap_2 = RemapNumbers(Value=graph, Source=Domain(0, 1), Target=dom)  # -> Mapped, Clipped; disabled

len = Length(Curve=crv_cityblocks_2)  # disabled
division = Division(A=len, B=remap_2.Mapped)  # disabled
divide = DivideCurve(Curve=crv_cityblocks_2, Count=division, Kinks=False)  # -> Points, Tangents, Parameters; disabled
shift = ShiftList(List=divide.Points, Shift=1, Wrap=True)  # disabled
ln_3 = Line(StartPoint=divide.Points, EndPoint=shift)  # disabled
crv_building_fronts = Curve(ln_3)  # disabled
