# Grasshopper definition  Urbanism_Barcelona .gh (Grasshopper 1.0.7)
# plug-ins: Human

# ---- group: GENERATIVE URBANISM REFERENCES
crv_streets = Curve([<curve referenced from the Rhino model> x52])  # disabled
crv_500x500 = Curve(<curve referenced from the Rhino model>)  # disabled
pt_attractor = Point([<point referenced from the Rhino model> x2])  # disabled
crv_church = Curve(<curve referenced from the Rhino model>)  # disabled
srf_topo = Surface(<surface referenced from the Rhino model>)  # disabled

# ----
crv_streets_2 = Curve([<curve referenced from the Rhino model> x41])
pt_attractor_2 = Point([<point referenced from the Rhino model> x2])
srf_topo_2 = Surface(<surface referenced from the Rhino model>)
crv_500x500_2 = Curve(<curve referenced from the Rhino model>)
crv_church_2 = Curve(<curve referenced from the Rhino model>)

# ---- group: GENERATIVE URBANISM REFERENCES / Join Streets
crv_streets_3 = Curve(crv_streets)  # disabled
objatts = ObjectAttributes(ObjectOrAttributes=crv_streets_3)  # -> Name, LayerName, LayerFullPath, Color, MaterialName, LinetypeName, GroupIndices, PlotWeight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; disabled
item = ListItem(List=objatts.UserDataValues, Index=0, Wrap=True)  # -> flatten(Item); disabled
cset = CreateSet(List=item)  # -> graft(Set), Map; disabled
equals = Equality(FirstNumber=cset.Set, SecondNumber=item)  # -> Equality, Inequality; disabled
cull = CullPattern(List=crv_streets_3, CullPattern=equals.Equality)  # disabled
join = JoinCurves(Curves=cull, Preserve=False)  # disabled
lng = ListLength(List=join)  # disabled
dup = DuplicateData(Data=cset.Set, Number=lng, Order=True)  # disabled

# ---- group: GENERATIVE URBANISM REFERENCES
crv_500x500_3 = Curve(crv_500x500)  # disabled
crv_coast = Curve(crv_church)  # disabled

boundary = BoundarySurfaces(Edges=crv_500x500_3)  # disabled
area = Area(Geometry=crv_coast)  # -> Area, Centroid; disabled
srfsplit = SurfaceSplit(Surface=boundary, Curves=crv_coast)  # -> graft(Fragments); disabled
srf_cp = SurfaceClosestPoint(Point=area.Centroid, Surface=srfsplit)  # -> Point, UVPoint, Distance; disabled
sort = SortList(Keys=srf_cp.Distance)  # -> Keys, ValuesA; disabled
item_2 = ListItem(List=sort.Keys, Index=0, Wrap=True)  # disabled
panel = Panel("0.1")  # disabled
smaller = SmallerThan(FirstNumber=item_2, SecondNumber=panel)  # -> SmallerThan, OrEqualTo; disabled
dispatch = Dispatch(List=srfsplit, DispatchPattern=smaller.SmallerThan)  # -> ListA, ListB; disabled

# ----
crv_streets_4 = Curve(crv_streets_2)
objatts_2 = ObjectAttributes(ObjectOrAttributes=crv_streets_4)  # -> Name, LayerName, LayerFullPath, Color, MaterialName, LinetypeName, GroupIndices, PlotWeight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
item_3 = ListItem(List=objatts_2.UserDataValues, Index=0, Wrap=True)  # -> flatten(Item)
cset_2 = CreateSet(List=item_3)  # -> graft(Set), Map
equals_2 = Equality(FirstNumber=cset_2.Set, SecondNumber=item_3)  # -> Equality, Inequality
cull_2 = CullPattern(List=crv_streets_4, CullPattern=equals_2.Equality)
join_2 = JoinCurves(Curves=cull_2, Preserve=False)
lng_2 = ListLength(List=join_2)
dup_2 = DuplicateData(Data=cset_2.Set, Number=lng_2, Order=True)

crv_500x500_4 = Curve(crv_500x500_2)
crv_church_3 = Curve(crv_church_2)

boundary_2 = BoundarySurfaces(Edges=crv_500x500_4)
area_2 = Area(Geometry=crv_church_3)  # -> Area, Centroid
srfsplit_2 = SurfaceSplit(Surface=boundary_2, Curves=crv_church_3)  # -> graft(Fragments)
srf_cp_2 = SurfaceClosestPoint(Point=area_2.Centroid, Surface=srfsplit_2)  # -> Point, UVPoint, Distance
sort_2 = SortList(Keys=srf_cp_2.Distance)  # -> Keys, ValuesA
item_4 = ListItem(List=sort_2.Keys, Index=0, Wrap=True)
smaller_2 = SmallerThan(FirstNumber=item_4, SecondNumber="0.1")  # -> SmallerThan, OrEqualTo
dispatch_2 = Dispatch(List=srfsplit_2, DispatchPattern=smaller_2.SmallerThan)  # -> ListA, ListB

# ---- group: GENERATIVE URBANISM REFERENCES
srf_ocean = Surface(dispatch.ListA)  # disabled
srf_land = Surface(dispatch.ListB)  # disabled

# ---- group: GENERATIVE URBANISM REFERENCES / Join Streets
num_streetwidths = Number(flatten(dup))  # disabled
crv_streets_5 = Curve(flatten(join))  # disabled

# ----
srf_city_blocks = Surface(dispatch_2.ListB)
srf_church = Surface(dispatch_2.ListA)

num_streetwidths_2 = Number(flatten(dup_2))
crv_streets_6 = Curve(flatten(join_2))

# ---- group: GENERATIVE URBANISM REFERENCES / Blocks
srf_ground = Surface(flatten(srf_land))  # disabled
crv_streets_7 = Curve(flatten(crv_streets_5))  # disabled
num_streetwidths_3 = Number(flatten(num_streetwidths))  # disabled

# ----
srf_ground_2 = Surface(flatten(srf_city_blocks))
crv_streets_8 = Curve(flatten(crv_streets_6))
num_streetwidths_4 = Number(flatten(num_streetwidths_2))

# ---- group: GENERATIVE URBANISM REFERENCES / Blocks
offset = OffsetCurve(Curve=graft(crv_streets_7), Distance=expr("x/2", graft(num_streetwidths_3)), Corners=1)  # disabled
offset_2 = OffsetCurve(Curve=graft(crv_streets_7), Distance=expr("-x/2", graft(num_streetwidths_3)), Corners=1)  # disabled
srfsplit_3 = SurfaceSplit(Surface=srf_ground, Curves=crv_streets_7)  # disabled
end = EndPoints(Curve=offset_2)  # -> Start, End; disabled
end_2 = EndPoints(Curve=offset)  # -> Start, End; disabled
graft = GraftTree(Tree=srfsplit_3, IncludeEmptyLists=True, IncludeNullItems=True)  # disabled
edges = BrepEdges(Brep=graft)  # -> Naked, Interior, NonManifold; disabled
ln = Line(StartPoint=end.End, EndPoint=end_2.End)  # disabled
ln_2 = Line(StartPoint=end.Start, EndPoint=end_2.Start)  # disabled
join_3 = JoinCurves(Curves=edges.Naked, Preserve=False)  # disabled
join_4 = JoinCurves(Curves=[offset, offset_2, ln_2, ln], Preserve=False)  # disabled
flatten = FlattenTree(Tree=join_4, Path="{0}")  # disabled
area_3 = Area(Geometry=join_3)  # -> Area, Centroid; disabled
srfsplit_4 = SurfaceSplit(Surface=graft, Curves=flatten)  # disabled
flatten_2 = FlattenTree(Tree=area_3.Centroid, Path="{0}")  # disabled
graft_2 = GraftTree(Tree=srfsplit_4, IncludeEmptyLists=True, IncludeNullItems=True)  # -> simplify(Tree); disabled
srf_cp_3 = SurfaceClosestPoint(Point=flatten_2, Surface=graft_2)  # -> Point, UVPoint, Distance; disabled
sort_3 = SortList(Keys=srf_cp_3.Distance)  # -> Keys, ValuesA; disabled
item_5 = ListItem(List=sort_3.Keys, Index=0, Wrap=True)  # disabled
panel_2 = Panel("0.1")  # disabled
smaller_3 = SmallerThan(FirstNumber=item_5, SecondNumber=panel_2)  # -> SmallerThan, OrEqualTo; disabled
cull_3 = CullPattern(List=graft_2, CullPattern=smaller_3.SmallerThan)  # disabled
edges_2 = BrepEdges(Brep=flatten(cull_3))  # -> Naked, Interior, NonManifold; disabled
join_5 = JoinCurves(Curves=edges_2.Naked, Preserve=False)  # disabled
crv_blocks = Curve(flatten(join_5))  # disabled

# ----
offset_3 = OffsetCurve(Curve=graft(crv_streets_8), Distance=expr("x/2", graft(num_streetwidths_4)), Plane=PlaneXY(0, 0, 0), Corners=1)
offset_4 = OffsetCurve(Curve=graft(crv_streets_8), Distance=expr("-x/2", graft(num_streetwidths_4)), Plane=PlaneXY(0, 0, 0), Corners=1)
srfsplit_5 = SurfaceSplit(Surface=srf_ground_2, Curves=crv_streets_8)
graft_3 = GraftTree(Tree=srfsplit_5, IncludeEmptyLists=True, IncludeNullItems=True)
edges_3 = BrepEdges(Brep=graft_3)  # -> Naked, Interior, NonManifold
end_3 = EndPoints(Curve=offset_3)  # -> Start, End
end_4 = EndPoints(Curve=offset_4)  # -> Start, End
join_6 = JoinCurves(Curves=edges_3.Naked, Preserve=False)
ln_3 = Line(StartPoint=end_4.End, EndPoint=end_3.End)
ln_4 = Line(StartPoint=end_4.Start, EndPoint=end_3.Start)
area_4 = Area(Geometry=join_6)  # -> Area, Centroid
join_7 = JoinCurves(Curves=[offset_4, offset_3, ln_4, ln_3], Preserve=False)
flatten_3 = FlattenTree(Tree=area_4.Centroid, Path="{0}")
flatten_4 = FlattenTree(Tree=join_7, Path="{0}")
srfsplit_6 = SurfaceSplit(Surface=graft_3, Curves=flatten_4)
graft_4 = GraftTree(Tree=srfsplit_6, IncludeEmptyLists=True, IncludeNullItems=True)  # -> simplify(Tree)
srf_cp_4 = SurfaceClosestPoint(Point=flatten_3, Surface=graft_4)  # -> Point, UVPoint, Distance
sort_4 = SortList(Keys=srf_cp_4.Distance)  # -> Keys, ValuesA
item_6 = ListItem(List=sort_4.Keys, Index=0, Wrap=True)
smaller_4 = SmallerThan(FirstNumber=item_6, SecondNumber="0.1")  # -> SmallerThan, OrEqualTo
cull_4 = CullPattern(List=graft_4, CullPattern=smaller_4.SmallerThan)
edges_4 = BrepEdges(Brep=flatten(cull_4))  # -> Naked, Interior, NonManifold
join_8 = JoinCurves(Curves=edges_4.Naked, Preserve=False)
crv_cityblocks = Curve(join_8)

# ---- group: GENERATIVE URBANISM REFERENCES
dispatch_3 = Dispatch(List=crv_blocks, DispatchPattern=[True, False])  # -> graft(ListA), graft(ListB); disabled
panel_3 = Panel("4")  # disabled
panel_4 = Panel("10")  # disabled
panel_5 = Panel("100")  # disabled
panel_6 = Panel("5")  # disabled
panel_7 = Panel("12")  # disabled
panel_8 = Panel("0.9")  # disabled
panel_9 = Panel("4")  # disabled
panel_10 = Panel("2")  # disabled
panel_11 = Panel("20")  # disabled
brep = Brep([<brep referenced from the Rhino model> x2])  # disabled

# ---- group: GENERATIVE URBANISM REFERENCES / Building Widths
crv_blocks_2 = Curve(simplify(graft(dispatch_3.ListA)))  # disabled
pt_attractor_3 = Point(pt_attractor)  # disabled
num_maxwidth = Number(panel_4)  # disabled
num_minwidth = Number(panel_3)  # disabled

# ----
crv_cityblocks_2 = Curve(simplify(graft(crv_cityblocks)))
pt_attractor_4 = Point(pt_attractor_2)
num_max_width = Number("12")
num_min_width = Number("5")

pt_attractor_5 = Point(pt_attractor_2)
num_max_width_2 = Number(num_max_width)
num_min_width_2 = Number(num_min_width)
explode = Explode(Curve=crv_cityblocks_2, Recursive=True)  # -> Segments, Vertices

# ---- group: Octagonal Blocks Option -2
number_slider = Slider(3, range=0..10)  # disabled
divide = DivideCurve(Curve=explode.Segments, Count=number_slider, Kinks=False)  # -> Points, Tangents, Parameters; disabled
panel_12 = Panel("2")  # disabled
panel_13 = Panel("1")  # disabled
lng_3 = ListLength(List=divide.Points)  # disabled
subtraction = Subtraction(A=lng_3, B=panel_12)  # disabled
item_7 = ListItem(List=divide.Points, Index=panel_13, Wrap=True)  # -> simplify(Item); disabled
item_8 = ListItem(List=divide.Points, Index=subtraction, Wrap=True)  # -> simplify(Item); disabled
path_mapper = PathMapper(item_8, source="{A;B}", target="{A}")  # disabled
path_mapper_2 = PathMapper(item_7, source="{A;B}", target="{A}")  # disabled
weave = Weave(Pattern=[0, 1], Stream0=path_mapper_2, Stream1=path_mapper, NullGaps=False)  # disabled
panel_14 = Panel("true")  # disabled
pline = PolyLine(Vertices=weave, Closed=panel_14)  # disabled
crv_building_octagons = Curve(pline)  # disabled

# ---- group: Octagonal Blocks
number_slider_2 = Slider(0.2, range=0..1)
subtraction_2 = Subtraction(A="1", B=number_slider_2)
eval = EvaluateLength(Curve=explode.Segments, Length=number_slider_2, Normalized=True)  # -> Point, Tangent, Parameter
panel_15 = Panel("""0
1""")
eval_2 = EvaluateLength(Curve=explode.Segments, Length=subtraction_2, Normalized=True)  # -> Point, Tangent, Parameter
weave_2 = Weave(Pattern=panel_15, Stream0=eval.Point, Stream1=eval_2.Point, NullGaps=False)
pline_2 = PolyLine(Vertices=weave_2, Closed="true")
crv_octagons = Curve(pline_2)

# ----
crv_octagons_2 = Curve(crv_octagons)

# ---- group: Building Fronts
area_5 = Area(Geometry=crv_octagons_2)  # -> Area, Centroid
dist = Distance(PointA=area_5.Centroid, PointB=pt_attractor_5)
sort_5 = SortList(Keys=dist)  # -> Keys, ValuesA
item_9 = ListItem(List=sort_5.Keys, Index="0", Wrap=True)
bnd = Bounds(Numbers=flatten(item_9))
dom = ConstructDomain(DomainStart=num_max_width_2, DomainEnd=num_min_width_2)
remap = RemapNumbers(Value=item_9, Source=bnd, Target=Domain(0, 1))  # -> Mapped, Clipped
graph = GraphMapper(
    remap.Mapped,
    x0=0,
    x1=1,
    y0=0,
    y1=1,
    container_name="Bezier",
    cpx=[0, 0.709219873, 0, 1],
    cpy=[0.005516171455, 0.02173912525, 1, 1])
remap_2 = RemapNumbers(Value=graph, Source=Domain(0, 1), Target=dom)  # -> Mapped, Clipped

len = Length(Curve=crv_octagons_2)
division = Division(A=len, B=remap_2.Mapped)
divide_2 = DivideCurve(Curve=crv_octagons_2, Count=division, Kinks=False)  # -> Points, Tangents, Parameters
shift = ShiftList(List=divide_2.Points, Shift=1, Wrap=True)
ln_5 = Line(StartPoint=divide_2.Points, EndPoint=shift)
crv_building_fronts = Curve(ln_5)

# ----
panel_16 = Panel("Generative Urbanism Reference")  # disabled

# ---- group: GENERATIVE URBANISM REFERENCES / Voronoi Buildings
num_buildingdensity = Number(panel_5)  # disabled
crv_blocks_3 = Curve(simplify(graft(dispatch_3.ListB)))  # disabled

bbox = BoundingBox(Content=crv_blocks_3, Plane=PlaneXY(0, 0, 0))  # -> Box, Box_2; disabled
area_6 = Area(Geometry=bbox.Box)  # -> Area, Centroid; disabled
division_2 = Division(A=area_6.Area, B=num_buildingdensity)  # disabled
pop2d = Populate2D(Region=bbox.Box, Count=division_2, Seed=1)  # -> simplify(Population); disabled
incurve = PointInCurve(Point=pop2d, Curve=crv_blocks_3)  # -> Relationship, Point; disabled
cull_5 = CullPattern(List=pop2d, CullPattern=incurve.Relationship)  # disabled
voronoi = Voronoi(Points=cull_5, Boundary=bbox.Box, BruteForceOverride=False)  # -> simplify(Cells); disabled
boundary_3 = BoundarySurfaces(Edges=voronoi)  # disabled
srfsplit_7 = SurfaceSplit(Surface=boundary_3, Curves=crv_blocks_3)  # disabled
path_mapper_3 = PathMapper(srfsplit_7, source="{A;B}", target="{A}")  # disabled
area_7 = Area(Geometry=path_mapper_3)  # -> Area, Centroid; disabled
incurve_2 = PointInCurve(Point=area_7.Centroid, Curve=crv_blocks_3)  # -> Relationship, Point; disabled
cull_6 = CullPattern(List=path_mapper_3, CullPattern=incurve_2.Relationship)  # disabled
edges_5 = BrepEdges(Brep=cull_6)  # -> Naked, Interior, NonManifold; disabled
join_9 = JoinCurves(Curves=edges_5.Naked, Preserve=False)  # disabled
panel_17 = Panel("1")  # disabled
panel_18 = Panel("4")  # disabled
reb = RebuildCurve(Curve=join_9, Degree=panel_17, Count=panel_18, Tangents=False)  # -> simplify(Curve); disabled
path_mapper_4 = PathMapper(reb, source="{A;B}", target="{A}")  # disabled
crv_buildingfootprints = Curve(path_mapper_4)  # disabled

# ----
crv_streets_9 = Curve(flatten(crv_streets_8))
crv_buildingfronts = Curve(simplify(graft(crv_building_fronts)))
pt_attractor_6 = Point(pt_attractor_4)
num_mindepth = Number(num_min_width)
num_maxdepth = Number(num_max_width)

crv_foorptints = Curve([<curve referenced from the Rhino model> x1147])
pt_attractor_7 = Point(pt_attractor_2)

# ---- group: GENERATIVE URBANISM REFERENCES / Building Widths
area_8 = Area(Geometry=crv_blocks_2)  # -> Area, Centroid; disabled
len_2 = Length(Curve=crv_blocks_2)  # disabled

dist_2 = Distance(PointA=area_8.Centroid, PointB=pt_attractor_3)  # disabled
sort_6 = SortList(Keys=dist_2)  # -> Keys, ValuesA; disabled
panel_19 = Panel("0")  # disabled
item_10 = ListItem(List=sort_6.Keys, Index=panel_19, Wrap=True)  # disabled
bnd_2 = Bounds(Numbers=flatten(item_10))  # disabled
dom_2 = ConstructDomain(DomainStart=num_maxwidth, DomainEnd=num_minwidth)  # disabled
remap_3 = RemapNumbers(Value=item_10, Source=bnd_2, Target=Domain(0, 1))  # -> Mapped, Clipped; disabled
graph_2 = GraphMapper(
    remap_3.Mapped,
    x0=0,
    x1=1,
    y0=0,
    y1=1,
    container_name="Bezier",
    cpx=[0, 0.1112657934, 0.01050777733, 1],
    cpy=[0, 0.762670517, 1, 1])  # disabled
remap_4 = RemapNumbers(Value=graph_2, Source=Domain(0, 1), Target=dom_2)  # -> Mapped, Clipped; disabled

division_3 = Division(A=len_2, B=remap_4.Mapped)  # disabled
divide_3 = DivideCurve(Curve=crv_blocks_2, Count=division_3, Kinks=False)  # -> Points, Tangents, Parameters; disabled
shift_2 = ShiftList(List=divide_3.Points, Shift=1, Wrap=True)  # disabled
ln_6 = Line(StartPoint=divide_3.Points, EndPoint=shift_2)  # disabled
crv_buildingfronts_2 = Curve(ln_6)  # disabled

# ---- group: GENERATIVE URBANISM REFERENCES / Building Depth
crv_streets_10 = Curve(flatten(crv_streets_5))  # disabled
crv_buildingfronts_3 = Curve(simplify(graft(crv_buildingfronts_2)))  # disabled
pt_attractor_8 = Point(pt_attractor)  # disabled
num_maxdepth_2 = Number(panel_7)  # disabled
num_mindepth_2 = Number(panel_6)  # disabled

midpt = CurveMiddle(Curve=crv_buildingfronts_3)  # disabled
crv_cp = CurveClosestPoint(Point=midpt, Curve=crv_streets_10)  # -> Point, Parameter, Distance; disabled
sort_7 = SortList(Keys=crv_cp.Distance, ValuesA=crv_cp.Point)  # -> Keys, ValuesA; disabled
item_11 = ListItem(List=sort_7.ValuesA, Index=0, Wrap=True)  # disabled
vec2pt = Vector2Pt(PointA=item_11, PointB=midpt, Unitize=False)  # -> Vector, Length; disabled
end_5 = EndPoints(Curve=crv_buildingfronts_3)  # -> Start, End; disabled

dist_3 = Distance(PointA=midpt, PointB=pt_attractor_8)  # disabled
sort_8 = SortList(Keys=dist_3)  # -> Keys, ValuesA; disabled
panel_20 = Panel("0")  # disabled
item_12 = ListItem(List=sort_8.Keys, Index=panel_20, Wrap=True)  # disabled
bnd_3 = Bounds(Numbers=flatten(item_12))  # disabled
dom_3 = ConstructDomain(DomainStart=num_maxdepth_2, DomainEnd=num_mindepth_2)  # disabled
remap_5 = RemapNumbers(Value=item_12, Source=bnd_3, Target=Domain(0, 1))  # -> Mapped, Clipped; disabled
graph_3 = GraphMapper(
    remap_5.Mapped,
    x0=0,
    x1=1,
    y0=0,
    y1=1,
    container_name="Bezier",
    cpx=[0, 0.4055331647, 0, 1],
    cpy=[0, 0.1889086962, 1, 1])  # disabled
remap_6 = RemapNumbers(Value=graph_3, Source=Domain(0, 1), Target=dom_3)  # -> Mapped, Clipped; disabled

amp = Amplitude(Vector=vec2pt.Vector, Amplitude=remap_6.Mapped)  # disabled
move = Move(Geometry=crv_buildingfronts_3, Motion=amp)  # -> Geometry, Transform; disabled
end_6 = EndPoints(Curve=move.Geometry)  # -> Start, End; disabled
merge = Merge(Data1=end_5.Start, Data2=end_5.End, Data3=end_6.End, Data4=end_6.Start)  # disabled
pline_3 = PolyLine(Vertices=merge, Closed=True)  # disabled
path_mapper_5 = PathMapper(pline_3, source="{A;B}", target="{A}")  # disabled
crv_buildingfootprints_2 = Curve(path_mapper_5)  # disabled

# ---- group: GENERATIVE URBANISM REFERENCES / Topography Footprints
crv_buildingfootprints_3 = Curve(crv_buildingfootprints_2)  # disabled
srf_topo_3 = Surface(srf_topo)  # disabled

cp = ControlPoints(Curve=crv_buildingfootprints_3)  # -> Points, Weights, Knots; disabled
Z = UnitZ(Factor=1)  # disabled
line = LineSDL(Start=cp.Points, Direction=Z, Length=1)  # disabled
slx = SurfaceLine(Surface=srf_topo_3, Line=line, LimitToFirst=False)  # -> Curves, Points, UVPoints, Normal; disabled
path_mapper_6 = PathMapper(slx.Points, source="{A;B;C}", target="{A;B}")  # disabled
pdecon = Deconstruct(Point=path_mapper_6)  # -> XComponent, YComponent, ZComponent; disabled
sort_9 = SortList(Keys=pdecon.ZComponent, ValuesA=path_mapper_6, ValuesB=cp.Points)  # -> Keys, ValuesA, ValuesB; disabled
item_13 = ListItem(List=sort_9.ValuesA, Index=0, Wrap=True)  # disabled
item_14 = ListItem(List=sort_9.ValuesB, Index=0, Wrap=True)  # disabled
vec2pt_2 = Vector2Pt(PointA=item_14, PointB=item_13, Unitize=False)  # -> Vector, Length; disabled
path_mapper_7 = PathMapper(vec2pt_2.Vector, source="{A;B}", target="{A}")  # disabled
move_2 = Move(Geometry=crv_buildingfootprints_3, Motion=path_mapper_7)  # -> Geometry, Transform; disabled
crv_buildingfootprints_4 = Curve(move_2.Geometry)  # disabled

# ---- group: GENERATIVE URBANISM REFERENCES / Building Height
crv_buildingfootprints_5 = Curve(crv_buildingfootprints_4)  # disabled
pt_attractor_9 = Point(pt_attractor)  # disabled
num_maxheight = Number(panel_11)  # disabled
num_minadjust = Number(panel_8)  # disabled
num_maxadjust = Number(panel_10)  # disabled
num_minheight = Number(panel_9)  # disabled

# ----
midpt_2 = CurveMiddle(Curve=crv_buildingfronts)
eval_3 = EvaluateLength(Curve=crv_buildingfronts, Length=Slider(1, range=0..1), Normalized=True)  # -> Point, Tangent, Parameter
crv_cp_2 = CurveClosestPoint(Point=midpt_2, Curve=crv_streets_9)  # -> Point, Parameter, Distance
pframe = PerpFrame(Curve=crv_buildingfronts, Parameter=eval_3.Parameter)
sort_10 = SortList(Keys=crv_cp_2.Distance, ValuesA=crv_cp_2.Point)  # -> Keys, ValuesA
item_15 = ListItem(List=sort_10.ValuesA, Index=0, Wrap=True)
deplane = DeconstructPlane(Plane=pframe)  # -> Origin, XAxis, YAxis, ZAxis
vec2pt_3 = Vector2Pt(PointA=item_15, PointB=midpt_2, Unitize=False)  # -> Vector, Length
vdis = VectorDisplay(Anchor=eval_3.Point, Vector=deplane.YAxis)
angle = Angle(VectorA=deplane.YAxis, VectorB=vec2pt_3.Vector)  # -> Angle, Reflex
deg = Degrees(Radians=angle.Angle)
smaller_5 = SmallerThan(FirstNumber=deg, SecondNumber="85")  # -> SmallerThan, OrEqualTo
dispatch_4 = Dispatch(List=deplane.YAxis, DispatchPattern=smaller_5.SmallerThan)  # -> ListA, ListB
end_7 = EndPoints(Curve=crv_buildingfronts)  # -> Start, End
rev = Reverse(Vector=dispatch_4.ListB)
weave_3 = Weave(Pattern=smaller_5.SmallerThan, Stream0=rev, Stream1=dispatch_4.ListA, NullGaps=False)

dist_4 = Distance(PointA=midpt_2, PointB=pt_attractor_6)
sort_11 = SortList(Keys=dist_4)  # -> Keys, ValuesA
item_16 = ListItem(List=sort_11.Keys, Index="0", Wrap=True)
bnd_4 = Bounds(Numbers=flatten(item_16))
remap_7 = RemapNumbers(Value=item_16, Source=bnd_4, Target=Domain(0, 1))  # -> Mapped, Clipped
graph_4 = GraphMapper(
    remap_7.Mapped,
    x0=0,
    x1=1,
    y0=0,
    y1=1,
    container_name="Bezier",
    cpx=[0, 0.6857015491, 0.363101095, 1],
    cpy=[0.1676425934, 0, 0.7204380035, 0.7751121521])
dom_4 = ConstructDomain(DomainStart=num_maxdepth, DomainEnd=num_mindepth)
remap_8 = RemapNumbers(Value=graph_4, Source=Domain(0, 1), Target=dom_4)  # -> Mapped, Clipped

amp_2 = Amplitude(Vector=weave_3, Amplitude=remap_8.Mapped)
move_3 = Move(Geometry=crv_buildingfronts, Motion=amp_2)  # -> Geometry, Transform
end_8 = EndPoints(Curve=move_3.Geometry)  # -> Start, End
merge_2 = Merge(Data1=end_7.Start, Data2=end_7.End, Data3=end_8.End, Data4=end_8.Start)
pline_4 = PolyLine(Vertices=merge_2, Closed=True)
path_mapper_8 = PathMapper(pline_4, source="{A;B}", target="{A}")
crv_buildingfootprints_6 = Curve(path_mapper_8)

# ---- group: Topogrpahy footprints
srf_topo_4 = Surface(srf_topo_2)
Z_2 = UnitZ(Factor=1)

crv_buildingfootprints_7 = Curve(crv_foorptints)
srf_topo_5 = Surface(srf_topo_4)

cp_2 = ControlPoints(Curve=crv_buildingfootprints_7)  # -> Points, Weights, Knots
line_2 = LineSDL(Start=cp_2.Points, Direction=Z_2, Length=1)
slx_2 = SurfaceLine(Surface=srf_topo_5, Line=line_2, LimitToFirst=False)  # -> Curves, Points, UVPoints, Normal
path_mapper_9 = PathMapper(slx_2.Points, source="{A;B;C}", target="{A;B}")
pdecon_2 = Deconstruct(Point=path_mapper_9)  # -> XComponent, YComponent, graft(ZComponent)
sort_12 = SortList(Keys=graft(pdecon_2.ZComponent), ValuesA=graft(path_mapper_9), ValuesB=graft(cp_2.Points))  # -> Keys, graft(ValuesA), graft(ValuesB)
item_17 = ListItem(List=sort_12.ValuesA, Index=0, Wrap=True)
item_18 = ListItem(List=sort_12.ValuesB, Index=0, Wrap=True)
vec2pt_4 = Vector2Pt(PointA=item_18, PointB=item_17, Unitize=False)  # -> Vector, Length
path_mapper_10 = PathMapper(vec2pt_4.Vector, source="{A;B}", target="{A}")
move_4 = Move(Geometry=crv_buildingfootprints_7, Motion=path_mapper_10)  # -> Geometry, Transform

# ----
crv = Curve(move_4.Geometry)

# ---- group: Building Heights
pt_attractor_10 = Point(pt_attractor_7)
crv_buildingfootprints_8 = Curve(crv)
num_maxheight_2 = Number("20")
num_minadjust_2 = Number("0.9")
num_maxadjust_2 = Number("2")
num_minheight_2 = Number("4")

# ---- group: GENERATIVE URBANISM REFERENCES / Building Height
pcen = PolygonCenter(Polyline=crv_buildingfootprints_5)  # -> CenterV, CenterE, CenterA; disabled
avr = Average(Input=pcen.CenterV)  # disabled
lng_4 = ListLength(List=crv_buildingfootprints_5)  # disabled
dom_5 = ConstructDomain(DomainStart=num_minadjust, DomainEnd=num_maxadjust)  # disabled
range = Range(Domain=dom_5, Steps=expr("x-1", lng_4))  # disabled
jitter = Jitter(List=range, Jitter=1, Seed=2)  # -> Values, Indices; disabled

dist_5 = Distance(PointA=avr, PointB=pt_attractor_9)  # disabled
sort_13 = SortList(Keys=dist_5)  # -> Keys, ValuesA; disabled
panel_21 = Panel("0")  # disabled
item_19 = ListItem(List=sort_13.Keys, Index=panel_21, Wrap=True)  # disabled
bnd_5 = Bounds(Numbers=flatten(item_19))  # disabled
dom_6 = ConstructDomain(DomainStart=num_maxheight, DomainEnd=num_minheight)  # disabled
remap_9 = RemapNumbers(Value=item_19, Source=bnd_5, Target=Domain(0, 1))  # -> Mapped, Clipped; disabled
graph_5 = GraphMapper(
    remap_9.Mapped,
    x0=0,
    x1=1,
    y0=0,
    y1=1,
    container_name="Bezier",
    cpx=[0, 0.1778936684, 0, 1],
    cpy=[0, 0.5957272053, 1, 1])  # disabled
remap_10 = RemapNumbers(Value=graph_5, Source=Domain(0, 1), Target=dom_6)  # -> Mapped, Clipped; disabled

Z_3 = UnitZ(Factor=remap_10.Mapped)  # disabled
dup_3 = DuplicateData(Data=Z_3, Number=lng_4, Order=True)  # disabled
multiplication = Multiplication(A=jitter.Values, B=dup_3)  # disabled

cp_3 = ControlPoints(Curve=crv_buildingfootprints_5)  # -> Points, Weights, Knots; disabled
panel_22 = Panel("1")  # disabled
vec_height = Vector(simplify(graft(multiplication)))  # disabled
panel_23 = Panel("0")  # disabled
panel_24 = Panel("2")  # disabled
panel_25 = Panel("3")  # disabled
item_20 = ListItem(List=cp_3.Points, Index=panel_24, Wrap=True)  # disabled
item_21 = ListItem(List=cp_3.Points, Index=panel_25, Wrap=True)  # disabled
item_22 = ListItem(List=cp_3.Points, Index=panel_23, Wrap=True)  # disabled
item_23 = ListItem(List=cp_3.Points, Index=panel_22, Wrap=True)  # disabled
move_5 = Move(Geometry=item_22, Motion=vec_height)  # -> Geometry, Transform; disabled
move_6 = Move(Geometry=item_20, Motion=vec_height)  # -> Geometry, Transform; disabled
move_7 = Move(Geometry=item_23, Motion=vec_height)  # -> Geometry, Transform; disabled
move_8 = Move(Geometry=item_21, Motion=vec_height)  # -> Geometry, Transform; disabled
tbox = TwistedBox(
    CornerA=item_22,
    CornerB=item_23,
    CornerC=item_20,
    CornerD=item_21,
    CornerE=move_5.Geometry,
    CornerF=move_7.Geometry,
    CornerG=move_6.Geometry,
    CornerH=move_8.Geometry)  # disabled

geo_buildingenvelope = Geometry(tbox)  # disabled
mesh = Mesh(tbox)  # disabled

# ---- group: GENERATIVE URBANISM REFERENCES
brep_2 = Brep(graft(geo_buildingenvelope))  # disabled
bbox_2 = BoundingBox(Content=brep_2, Plane=PlaneXY(0, 0, 0))  # -> Box, Box_2; disabled
debox = DeconstructBox(Box=bbox_2.Box)  # -> Plane, X, Y, Z; disabled
dedomain = DeconstructDomain(Domain=debox.Z)  # -> Start, End; disabled
dedomain_2 = DeconstructDomain(Domain=debox.X)  # -> Start, End; disabled
dedomain_3 = DeconstructDomain(Domain=debox.Y)  # -> Start, End; disabled
subtraction_3 = Subtraction(A=dedomain.End, B=dedomain.Start)  # disabled
panel_26 = Panel("4")  # disabled
division_4 = Division(A=subtraction_3, B=panel_26)  # disabled
int = Integer(division_4)  # disabled
division_5 = Division(A=subtraction_3, B=int)  # disabled
panel_27 = Panel("2")  # disabled
division_6 = Division(A=division_5, B=panel_27)  # disabled
addition = Addition(A=dedomain.Start, B=division_6)  # disabled
mesh_2 = MeshBrep(
    Brep=brep_2,
    Settings={GridMaxCount=0, GridMinCount=16, JaggedSeams=False, MaxEdgeLength=0, MinEdgeLength=0.0001, MinTolerance=0, Refine=True, RefineAngle=0, RelativeTolerance=0.65, SimplePlanes=True, Tolerance=0})  # disabled
pt = ConstructPoint(XCoordinate=dedomain_2.Start, YCoordinate=dedomain_3.Start, ZCoordinate=addition)  # disabled
box = CenterBox(Base=pt, X=division_6, Y=division_6, Z=division_6)  # disabled
boxmap = BoxMapping(Mesh=mesh_2, Box=box)  # disabled
path = FilePath("C:\Users\mconway\Downloads\UCLA\testtexture.PNG")  # disabled
previewmat = CustomPreviewMaterials(Geometry=boxmap, DiffuseColor=RGB(255, 255, 255), DiffuseBitmap=path)  # disabled
mesh_mappedenvelope = Mesh(boxmap)  # disabled

# ---- group: Building Heights
pcen_2 = PolygonCenter(Polyline=crv_buildingfootprints_8)  # -> CenterV, CenterE, CenterA
avr_2 = Average(Input=pcen_2.CenterV)
lng_5 = ListLength(List=crv_buildingfootprints_8)
dom_7 = ConstructDomain(DomainStart=num_minadjust_2, DomainEnd=num_maxadjust_2)
range_2 = Range(Domain=dom_7, Steps=expr("x-1", lng_5))
jitter_2 = Jitter(List=range_2, Jitter=1, Seed=2)  # -> Values, Indices

dist_6 = Distance(PointA=avr_2, PointB=pt_attractor_10)
sort_14 = SortList(Keys=dist_6)  # -> Keys, ValuesA
item_24 = ListItem(List=sort_14.Keys, Index="0", Wrap=True)
bnd_6 = Bounds(Numbers=flatten(item_24))
dom_8 = ConstructDomain(DomainStart=num_maxheight_2, DomainEnd=num_minheight_2)
remap_11 = RemapNumbers(Value=item_24, Source=bnd_6, Target=Domain(0, 1))  # -> Mapped, Clipped
graph_6 = GraphMapper(
    remap_11.Mapped,
    x0=0,
    x1=1,
    y0=0,
    y1=1,
    container_name="Bezier",
    cpx=[0, 0.1778936684, 0, 1],
    cpy=[0, 0.5957272053, 1, 1])
remap_12 = RemapNumbers(Value=graph_6, Source=Domain(0, 1), Target=dom_8)  # -> Mapped, Clipped

Z_4 = UnitZ(Factor=remap_12.Mapped)
dup_4 = DuplicateData(Data=Z_4, Number=lng_5, Order=True)
multiplication_2 = Multiplication(A=jitter_2.Values, B=dup_4)

cp_4 = ControlPoints(Curve=crv_buildingfootprints_8)  # -> Points, Weights, Knots
vec_height_2 = Vector(simplify(graft(multiplication_2)))
item_25 = ListItem(List=cp_4.Points, Index="2", Wrap=True)
item_26 = ListItem(List=cp_4.Points, Index="3", Wrap=True)
item_27 = ListItem(List=cp_4.Points, Index="0", Wrap=True)
item_28 = ListItem(List=cp_4.Points, Index="1", Wrap=True)
move_9 = Move(Geometry=item_27, Motion=vec_height_2)  # -> Geometry, Transform
move_10 = Move(Geometry=item_25, Motion=vec_height_2)  # -> Geometry, Transform
move_11 = Move(Geometry=item_28, Motion=vec_height_2)  # -> Geometry, Transform
move_12 = Move(Geometry=item_26, Motion=vec_height_2)  # -> Geometry, Transform
tbox_2 = TwistedBox(
    CornerA=item_27,
    CornerB=item_28,
    CornerC=item_25,
    CornerD=item_26,
    CornerE=move_9.Geometry,
    CornerF=move_11.Geometry,
    CornerG=move_10.Geometry,
    CornerH=move_12.Geometry)

geo_buildingenvelope_2 = Geometry(tbox_2)
mesh_3 = Mesh(tbox_2)
